# Grasshopper definition bart_tiles.gh (Grasshopper 1.0.8)
# plug-ins: RhinoCodePluginGH

sint = SolidIntersection()
crv = Curve(<curve referenced from the Rhino model>)
crv_2 = Curve(<curve referenced from the Rhino model>)
project = Project(Direction=Vector(0, 0, 1))
surface2 = Brep(<brep referenced from the Rhino model>)
surface1 = Brep(<brep referenced from the Rhino model>)
cploft = ControlPointLoft(Curves=[crv, crv_2], Degree=5)
spacing = Slider(1.67152, range=1..5)
count = Slider(100, range=0..100)
tile = Brep(<brep referenced from the Rhino model>)
crv_3 = Curve([<curve referenced from the Rhino model> x5])
bbox = BoundingBox(Content=tile, Plane=PlaneXY(0, 0, 0))  # -> Box, Box_2
hexgrid = Hexagonal(Plane=PlaneXY(0, 0, 0), Size=spacing, ExtentX=count, ExtentY=count)  # -> Cells, Points
loft = Loft(Curves=crv_3, Options={Adjust=False, Closed=False, LoftEnds=0, LoftSimp=0, LoftType=0, Rebuild=10, Refit=0.01})
brep = Brep([<brep referenced from the Rhino model> x4])
orient = Orient(Geometry=tile, Source=bbox.Box, Target=hexgrid.Points)  # -> Geometry, Transform
loftedsrf = Brep(loft)
srf = Surface(loftedsrf)
Z = UnitZ(Factor=1)
xy = XYPlane(Origin=Point(0, 0, 0))
flatten = FlattenTree(Tree=orient.Geometry, Path="{0}")
dedom2 = DeconstructDomain²(Domain=srf)  # -> UComponent, VComponent
bbox_2 = BoundingBox(Content=flatten, Plane=PlaneXY(0, 0, 0), UnionBox=True)  # -> Box, Box_2
line = LineSDL(Start=xy, Direction=Z, Length=Slider(300, range=0..500))
srfmorph = SurfaceMorph(
    Geometry=orient.Geometry,
    Reference=bbox_2.Box,
    Surface=srf,
    UDomain=dedom2.UComponent,
    VDomain=dedom2.VComponent,
    WDomain=Slider(2, range=0..10))
flatten_2 = FlattenTree(Tree=srfmorph, Path="{0}")
group = Group(Geometry=flatten_2)
move = Move(Motion=line)  # -> Geometry, Transform
c_script = CSharpScript(
    switcher=Toggle(True),
    canvas_back=ColourSwatch(SwatchColor=RGB(255, 254, 255)),
    canvas_grid=ColourSwatch(SwatchColor=RGB(255, 254, 255)))  # -> out, A; inputs switcher: Boolean, canvas_back: Color, canvas_grid: Color
# ---------- c_script: C# ----------
// Grasshopper Script Instance
#region Usings
using System;
using System.Linq;
using System.Collections;
using System.Collections.Generic;
using System.Drawing;

using Rhino;
using Rhino.Geometry;

using Grasshopper;
using Grasshopper.Kernel;
using Grasshopper.Kernel.Data;
using Grasshopper.Kernel.Types;
#endregion

public class Script_Instance : GH_ScriptInstance
{
private void RunScript(
	bool switcher,
	Color canvas_back,
	Color canvas_grid,
	ref object A)
  {
    if (switcher == true)
    {
      Grasshopper.GUI.Canvas.GH_Skin.canvas_grid = canvas_grid;
      Grasshopper.GUI.Canvas.GH_Skin.canvas_back = canvas_back; 
      Grasshopper.GUI.Canvas.GH_Skin.canvas_edge = Color.FromArgb(255, 0, 0, 0); 
      Grasshopper.GUI.Canvas.GH_Skin.canvas_shade = Color.FromArgb(80, 0, 0, 0); 
    }
    else
    {
      //DEFAULTS
      Grasshopper.GUI.Canvas.GH_Skin.canvas_grid = Color.FromArgb(30, 0, 0, 0);
      Grasshopper.GUI.Canvas.GH_Skin.canvas_back = Color.FromArgb(255, 212, 208, 200); 
      Grasshopper.GUI.Canvas.GH_Skin.canvas_edge = Color.FromArgb(255, 0, 0, 0); 
      Grasshopper.GUI.Canvas.GH_Skin.canvas_shade = Color.FromArgb(80, 0, 0, 0);
    }
  }
}
# ---------- end c_script ----------
